# Dynamo graph CSharpInDynamo.dyn "CSharpC#InDynamo" (Dynamo 2.0.2.6826)

code_block = CodeBlock()
# ---------- code_block.designscript (33 lines) ----------
"
using System;
using System.Collections.Generic;
using System.Linq;
using System.Text;
using System.Threading.Tasks;
using Autodesk.DesignScript.RunTime;
using Autodesk.DesignScript.Interfaces;
using Autodesk.DesignScript.Geometry;

public class ZeroTouchTest
{
    private Int64 _x;
    private Int64 _y;
    private Int64 _z;

    internal ZeroTouchTest(Int64 x, Int64 y, Int64 z)
    {
        _x = x;
        _y = y;
        _z = z:
    }
    public static Line ByTwoDoubles(Int64 x, Int64 y, Int64 z)
    {
       Point p1 = Point.ByCoordinates(x, y, z);
       Point p2 = Point.ByCoordinates(x + 10, y + 10, z + 10);
       Line line = Line.ByStartPiontEndPoint(p1,p2);
       p1.Dispose();
       p2.Dispose();
       return line;
    }
}
";
# ----------------------------------------
code_block_2 = CodeBlock { []; }
fromString = Scripting.CSharpScript.FromString(script=code_block, IN=code_block_2, CustomAssemblies=code_block_2)
code_block_3 = CodeBlock()  # //package = dynamic c sharp interpreter, works with dynamo 1 & 2
code_block_4 = CodeBlock()
# ---------- code_block_4.designscript (36 lines) ----------
"
using System;
using System.Collections.Generic;
using System.Linq;
using System.Text;
using System.Threading.Tasks;
using Autodesk.DesignScript.RunTime;
using Autodesk.DesignScript.Interfaces;
using Autodesk.DesignScript.Geometry;

namespace MyTest
{
    public class ZeroTouchTest
    {
        private Int64 _x;
        private Int64 _y;
        private Int64 _z;

        internal ZeroTouchTest(Int64 x, Int64 y, Int64 z)
        {
            _x = x;
            _y = y;
            _z = z:
        }
        public static Line ByTwoDoubles(Int64 x, Int64 y, Int64 z)
        {
           Point p1 = Point.ByCoordinates(x, y, z);
           Point p2 = Point.ByCoordinates(x + 10, y + 10, z + 10);
           Line line = Line.ByStartPiontEndPoint(p1,p2);
           p1.Dispose();
           p2.Dispose();
           return line;
        }
    }
}
";
# ----------------------------------------
fromString_2 = Scripting.CSharpScript.FromString(script=code_block_4, IN=code_block_2, CustomAssemblies=code_block_2)
code_block_5 = CodeBlock()
# ---------- code_block_5.designscript (13 lines) ----------
"
using System;

var a = (Int64)IN[0];
var b = (Int64)IN[1];

Int64 test()
{
return a * a + b * b;
}

return test();
";
# ----------------------------------------
integer_slider = IntegerSlider(26, range=0..100 step 1)
code_block_6 = CodeBlock(x=integer_slider) { [x, 6]; []; }
fromString_3 = Scripting.CSharpScript.FromString(script=code_block_5, IN=code_block_6.out0, CustomAssemblies=code_block_6.out1)
code_block_7 = CodeBlock()
# ---------- code_block_7.designscript (36 lines) ----------
"
using System;
using System.Collections.Generic;
using System.Linq;
using System.Text;
using System.Threading.Tasks;
using Autodesk.DesignScript.RunTime;
using Autodesk.DesignScript.Interfaces;
using Autodesk.DesignScript.Geometry;

namespace MyTest
{
    public class ZeroTouchTest
    {
        private double _x;
        private double _y;
        private double _z;

        internal ZeroTouchTest(double x, double y, double z)
        {
            _x = x;
            _y = y;
            _z = z:
        }
        public static Line ByTwoDoubles(double x, double y, double z)
        {
           Point p1 = Point.ByCoordinates(x, y, z);
           Point p2 = Point.ByCoordinates(x + 10, y + 10, z + 10);
           Line line = Line.ByStartPiontEndPoint(p1,p2);
           p1.Dispose();
           p2.Dispose();
           return line;
        }
    }
}
";
# ----------------------------------------
code_block_8 = CodeBlock()
# ---------- code_block_8.designscript (33 lines) ----------
"
using System;
using System.Collections.Generic;
using System.Linq;
using System.Text;
using System.Threading.Tasks;
using Autodesk.DesignScript.RunTime;
using Autodesk.DesignScript.Interfaces;
using Autodesk.DesignScript.Geometry;

public class ZeroTouchTest
{
    private double _x;
    private double _y;
    private double _z;

    internal ZeroTouchTest(double x, double y, double z)
    {
        _x = x;
        _y = y;
        _z = z:
    }
    public static Line ByTwoDoubles(double x, double y, double z)
    {
       Point p1 = Point.ByCoordinates(x, y, z);
       Point p2 = Point.ByCoordinates(x + 10, y + 10, z + 10);
       Line line = Line.ByStartPiontEndPoint(p1,p2);
       p1.Dispose();
       p2.Dispose();
       return line;
    }
}
";
# ----------------------------------------
