# Dynamo graph Color Overrides.dyn (Dynamo 1.0.0.1180)

# group: **COLOR DRIVER CONTROL**
code_block = CodeBlock { 255; 165; 0; }
ORANGE = Color.ByARGB(r=code_block.out0, g=code_block.out1, b=code_block.out2)  # "Color.ORANGE"
code_block_2 = CodeBlock { 255; 0; }
GREEN = Color.ByARGB(r=code_block_2.out1, g=code_block_2.out0, b=code_block_2.out1)  # "Color.GREEN"
code_block_3 = CodeBlock { 255; 0; }
RED = Color.ByARGB(r=code_block_3.out0, g=code_block_3.out1, b=code_block_3.out1)  # "Color.RED"
code_block_4 = CodeBlock { 255; 0; }
BLUE = Color.ByARGB(r=code_block_4.out1, g=code_block_4.out1, b=code_block_4.out0)  # "Color.BLUE"
code_block_5 = CodeBlock { 0; 100; 0; }
byARGB = Color.ByARGB(r=code_block_5.out0, g=code_block_5.out1, b=code_block_5.out2)
code_block_6 = CodeBlock { 0; }
BLACK = Color.ByARGB(r=code_block_6, g=code_block_6, b=code_block_6)  # "Color.BLACK"

# group: **NOT IN USE, FILLS OBJECTS WITH A SOLID COLOR**
overrideColorInView = Element.OverrideColorInView(color=ORANGE)
overrideColorInView_2 = Element.OverrideColorInView(color=GREEN)
overrideColorInView_3 = Element.OverrideColorInView(color=RED)
overrideColorInView_4 = Element.OverrideColorInView(color=BLUE)
overrideColorInView_5 = Element.OverrideColorInView(color=BLUE)
overrideColorInView_6 = Element.OverrideColorInView(color=RED)
overrideColorInView_7 = Element.OverrideColorInView(color=byARGB)
overrideColorInView_8 = Element.OverrideColorInView(color=ORANGE)
overrideColorInView_9 = Element.OverrideColorInView(color=GREEN)
overrideColorInView_10 = Element.OverrideColorInView(color=byARGB)
overrideColorInView_11 = Element.OverrideColorInView(color=BLACK)

# group: **START HERE, AFTER 'SELECT MODEL ELEMENTS', IMMEDIATELY GO TO A REVIT WINDOW AND PERFORM A CROSSING SELECTION OF THE ITEMS WITH A VALID SPOOL TAG AND COLOR OVERRIDE WILL TAKE PLACE AUTOMATICALLY. ITEMS WITHOUT A VALID SPOOL TAG WILL BE BYPASSED. IF YOU NEED TO ASSIGN A COLOR TO AN OBJECT, SIMPLY ENTER A 0 - 9 VALUE UNDER THE SPOOL TAG PARAMETER.**
select_model_elements = DSModelElementsSelection()  # 24 picked in the model
code_block_7 = CodeBlock { "SPOOL COLOR ASSIGNMENT FOR SPOOL MAPS"; "BY J PARKER"; "JH KELLY LLC 2016"; "V1.00"; }

# group: **SELECTION SET LIST, DROP ITEMS WITH A BLANK SPOOL TAG**
code_block_8 = CodeBlock { "Spool Tag"; }
getParameterValueByName = Element.GetParameterValueByName(element=select_model_elements, parameterName=code_block_8)
code_block_9 = CodeBlock { ""; }
eq = getParameterValueByName == code_block_9
filterByBoolMask = List.FilterByBoolMask(list=select_model_elements, mask=eq)
watch = Watch(filterByBoolMask.out)

# group: **FILTER SPOOL TAGS FOR ANY VALUE, CHECK SPOOL TAG LENGTH, DROP ALL DIGITS BUT THE LAST CHARACTER**
code_block_10 = CodeBlock { ""; }
eq_2 = getParameterValueByName == code_block_10
filterByBoolMask_2 = List.FilterByBoolMask(list=getParameterValueByName, mask=eq_2)
boolean = BoolSelector(true)
clean = List.Clean(list=filterByBoolMask_2.out, preserveIndices=boolean)
length = String.Length(clean)
code_block_11 = CodeBlock(X=length) { -X; X; X=1; }
substring = String.Substring(str=clean, startIndex=code_block_11.out0, length=code_block_11.out1)
watch_2 = Watch(substring)

# group: **FILTERS ALL VALID SPOOL NUMBERS, ASSIGNS MATCHING SPOOL NUMBER DIGIT TO COLOR.**
code_block_12 = CodeBlock { "1"; "2"; "3"; "4"; "5"; "6"; "7"; "8"; "9"; "0"; "-"; }
eq_3 = watch_2 == code_block_12.out2
filterByBoolMask_3 = List.FilterByBoolMask(list=watch, mask=eq_3)
eq_4 = watch_2 == code_block_12.out6
filterByBoolMask_4 = List.FilterByBoolMask(list=watch, mask=eq_4)
eq_5 = watch_2 == code_block_12.out10
filterByBoolMask_5 = List.FilterByBoolMask(list=watch, mask=eq_5)
eq_6 = watch_2 == code_block_12.out9
filterByBoolMask_6 = List.FilterByBoolMask(list=watch, mask=eq_6)
eq_7 = watch_2 == code_block_12.out8
filterByBoolMask_7 = List.FilterByBoolMask(list=watch, mask=eq_7)
eq_8 = watch_2 == code_block_12.out7
filterByBoolMask_8 = List.FilterByBoolMask(list=watch, mask=eq_8)
eq_9 = watch_2 == code_block_12.out5
filterByBoolMask_9 = List.FilterByBoolMask(list=watch, mask=eq_9)
eq_10 = watch_2 == code_block_12.out4
filterByBoolMask_10 = List.FilterByBoolMask(list=watch, mask=eq_10)
eq_11 = watch_2 == code_block_12.out3
filterByBoolMask_11 = List.FilterByBoolMask(list=watch, mask=eq_11)
eq_12 = watch_2 == code_block_12.out1
filterByBoolMask_12 = List.FilterByBoolMask(list=watch, mask=eq_12)
eq_13 = watch_2 == code_block_12.out0
filterByBoolMask_13 = List.FilterByBoolMask(list=watch, mask=eq_13)

# group: **COLOR BARS FOR VISUAL REFERENCE ONLY, NOT DRIVING COLOR ON OBJECTS!!**
code_block_13 = CodeBlock { 1; }
color_range = ColorRange(byARGB, code_block_13, code_block_13)
color_range_2 = ColorRange(BLUE, code_block_13, code_block_13)
color_range_3 = ColorRange(GREEN, code_block_13, code_block_13)
color_range_4 = ColorRange(ORANGE, code_block_13, code_block_13)
color_range_5 = ColorRange(RED, code_block_13, code_block_13)
color_range_6 = ColorRange(BLACK, code_block_13, code_block_13)

watch_3 = Watch(filterByBoolMask.in)
overrideProjectionLineColor = Custom[Element.OverrideProjectionLineColor](element=filterByBoolMask_5.in)  # This node overrides the projection line color with the input color value. Useful for annotation.
overrideProjectionLineColor_2 = Custom[Element.OverrideProjectionLineColor](element=filterByBoolMask_5.in, color=GREEN)
overrideProjectionLineColor_3 = Custom[Element.OverrideProjectionLineColor](element=filterByBoolMask_6.in, color=ORANGE)
overrideProjectionLineColor_4 = Custom[Element.OverrideProjectionLineColor](element=filterByBoolMask_7.in, color=byARGB)
overrideProjectionLineColor_5 = Custom[Element.OverrideProjectionLineColor](element=filterByBoolMask_8.in, color=RED)
overrideProjectionLineColor_6 = Custom[Element.OverrideProjectionLineColor](element=filterByBoolMask_9.in, color=BLUE)
overrideProjectionLineColor_7 = Custom[Element.OverrideProjectionLineColor](element=filterByBoolMask_10.in, color=GREEN)
overrideProjectionLineColor_8 = Custom[Element.OverrideProjectionLineColor](element=filterByBoolMask_11.in, color=ORANGE)
overrideProjectionLineColor_9 = Custom[Element.OverrideProjectionLineColor](element=filterByBoolMask_12.in, color=byARGB)
overrideProjectionLineColor_10 = Custom[Element.OverrideProjectionLineColor](element=filterByBoolMask_13.in, color=RED)
overrideProjectionLineColor_11 = Custom[Element.OverrideProjectionLineColor](element=filterByBoolMask_13.in, color=BLUE)
