# Dynamo graph Convex_Hull_Example.dyn (Dynamo 1.3.0.875)

code_block = CodeBlock()
# ---------- code_block.designscript (5 lines) ----------
def pts(l: var[])
{
return = Autodesk.Point.ByCoordinates
(l[0],l[1],l[2]);
};
# ----------------------------------------
file_path = Filename("C:\Users\RGovindarajan\Downloads\Book1.xlsx")
fromPath = FileObject(file_path)  # "File.FromPath"
code_block_2 = CodeBlock { "Sheet1"; }
readFromFile = Excel.ReadFromFile(file=fromPath, sheetName=code_block_2)
code_block_3 = CodeBlock(l=readFromFile) { pts(l); }
byPoints = Tessellation.ConvexHull.ByPoints(code_block_3)
code_block_4 = CodeBlock { 3; }
chop = List.Chop(list=byPoints, lengths=code_block_4)
byJoinedCurves = PolyCurve.ByJoinedCurves(chop)
byPatch = Surface.ByPatch(byJoinedCurves)
byJoinedSurfaces = Solid.ByJoinedSurfaces(byPatch)
categories = Categories("Walls")
code_block_5 = CodeBlock { "Concrete, Precast"; }
byName = Material.ByName(code_block_5)
byGeometry = DirectShape.ByGeometry(category=categories, material=byName)  # unwired: geometry
code_block_6 = CodeBlock { 1873; }
convexHull2D = Custom[Springs.Points.ConvexHull2D](points=code_block_3, elevation=code_block_6)  # Computes the XY convex hull of a given set of points based on the monotone chain algorithm.
