# Dynamo graph DynaMenorah.dyn (Dynamo 1.2.0.1955)

now = DateTime.Now()
watch = Watch(now)
code_block = CodeBlock { 0; }
byCoordinates = Point.ByCoordinates(x=code_block, y=code_block, z=code_block)

# group: Menorah Parameters
stem_height = DoubleSlider(9.9, range=0..100 step 0.1)
how_many_nights_would_you_like = IntegerSlider(8, range=0..100 step 1)  # "HOW MANY NIGHTS WOULD YOU LIKE TO CELEBRATE?"
SPACING = DoubleSlider(3.9, range=0..100 step 0.1)
pipe_radius = DoubleSlider(0.6, range=0..100 step 0.1)

code_block_2 = CodeBlock { 2; }

# group: Calculate how many "arms" are on each side
code_block_3 = CodeBlock { 1; }
div = how_many_nights_would_you_like / code_block_2
code_block_4 = CodeBlock { 1; }
sub = div - code_block_4
floor = Math.Floor(sub)
add = code_block_3 + floor
divRem = Math.DivRem(how_many_nights_would_you_like, code_block_2)
add_2 = add + divRem

# group: Calculate the radius of each menorah arm
range = Range(start=code_block_3, end=add, lacing=Longest)
mul = range * SPACING
range_2 = Range(start=code_block_3, end=add_2, lacing=Longest)
mul_2 = range_2 * SPACING
code_block_5 = CodeBlock { -1; }
mul_3 = mul_2 * code_block_5

lastItem = List.LastItem(mul)
add_3 = stem_height + lastItem
translate = Geometry.Translate(geometry=byCoordinates, zTranslation=add_3)

# group: Generate arcs to sweep "arms" along
code_block_6 = CodeBlock { 0; -90; }
YAxis = Vector.YAxis()
byCenterPointRadiusAngle = Arc.ByCenterPointRadiusAngle(center=translate, radius=mul, startAngle=code_block_6.out0, endAngle=code_block_6.out1, normal=YAxis)
reverse = List.Reverse(byCenterPointRadiusAngle)
code_block_7 = CodeBlock { 0; 90; }
YAxis_2 = Vector.YAxis()
byCenterPointRadiusAngle_2 = Arc.ByCenterPointRadiusAngle(center=translate, radius=mul_3, startAngle=code_block_7.out0, endAngle=code_block_7.out1, normal=YAxis_2)
create = List.Create(reverse, byCenterPointRadiusAngle_2)
watch_2 = Watch(create)
flatten = Flatten(create)

code_block_8 = CodeBlock { 2; }
div_2 = SPACING / code_block_8
translate_2 = Geometry.Translate(geometry=translate, zTranslation=div_2)
byStartPointEndPoint = Line.ByStartPointEndPoint(startPoint=translate_2, endPoint=byCoordinates)
startPoint = Curve.StartPoint(byStartPointEndPoint)
pipe_radius_2 = Watch(pipe_radius)
code_block_9 = CodeBlock { 1.7; }
mul_4 = pipe_radius_2 * code_block_9
byCenterPointRadius = Circle.ByCenterPointRadius(centerPoint=startPoint, radius=mul_4)
startPoint_2 = Curve.StartPoint(flatten)
byCenterPointRadius_2 = Circle.ByCenterPointRadius(centerPoint=startPoint_2, radius=mul_4)
create_2 = List.Create(byCenterPointRadius, byCenterPointRadius_2)
flatten_2 = Flatten(create_2)
code_block_10 = CodeBlock { 0.5; }

# group: Menorah candle bases
extrudeAsSolid = Curve.ExtrudeAsSolid(flatten_2, code_block_10)

byCenterPointRadius_3 = Circle.ByCenterPointRadius(centerPoint=startPoint_2, radius=pipe_radius_2)
byCenterPointRadius_4 = Circle.ByCenterPointRadius(radius=pipe_radius_2)

# group: Menorah "arms"
sweepAsSolid = Curve.SweepAsSolid(byCenterPointRadius_3, flatten)
sweepAsSolid_2 = Curve.SweepAsSolid(byCenterPointRadius_4, byStartPointEndPoint)

code_block_11 = CodeBlock { 3; }
div_3 = lastItem / code_block_11
byCenterPointRadius_5 = Circle.ByCenterPointRadius(centerPoint=byCoordinates, radius=div_3)

# group: Menorah Base
extrudeAsSolid_2 = Curve.ExtrudeAsSolid(byCenterPointRadius_5, pipe_radius)

addItemToFront = List.AddItemToFront(item=startPoint, list=startPoint_2)
translate_3 = Geometry.Translate(geometry=addItemToFront, zTranslation=code_block_10)

# group: What date does Hanukkah start?
code_block_12 = CodeBlock { 2016; 12; 24; 0; }
byDateAndTime = DateTime.ByDateAndTime(code_block_12.out0, code_block_12.out1, code_block_12.out2, code_block_12.out3, code_block_12.out3, code_block_12.out3, code_block_12.out3)

# group: Which night of Hanukkah is it?
byDateDifference = TimeSpan.ByDateDifference(now, byDateAndTime)
totalDays = TimeSpan.TotalDays(byDateDifference)
floor_2 = Math.Floor(totalDays)
code_block_13 = CodeBlock { 1; }
add_4 = floor_2 + code_block_13

range_3 = Range(end=add_4, lacing=Longest)
getItemAtIndex = List.GetItemAtIndex(list=translate_3, index=range_3)

# group: Candle Parameters
candle_height = DoubleSlider(10, range=0..100 step 0.1)
candle_flame_height = DoubleSlider(3.9, range=0..100 step 0.1)
candle_width_factor = DoubleSlider(0.4, range=0..100 step 0.1)

translate_4 = Geometry.Translate(geometry=getItemAtIndex, zTranslation=candle_height)

# group: Construct flame geometry
flatten_3 = Flatten(translate_4)
code_block_14 = CodeBlock { 7; }
div_4 = candle_flame_height / code_block_14
translate_5 = Geometry.Translate(geometry=flatten_3, zTranslation=div_4)
byCenterPointRadius_6 = Sphere.ByCenterPointRadius(centerPoint=translate_5, radius=div_4)
ZAxis = Vector.ZAxis()
byOriginNormal = Plane.ByOriginNormal(origin=translate_5, normal=ZAxis)
split = Geometry.Split(geometry=byCenterPointRadius_6, other=byOriginNormal)
transpose = List.Transpose(split)
code_block_15 = CodeBlock { 0; }
translate_6 = Geometry.Translate(geometry=translate_5, zTranslation=div_4)
sub_2 = candle_flame_height - div_4
translate_7 = Geometry.Translate(geometry=flatten_3, zTranslation=sub_2)
code_block_16 = CodeBlock { 1; }
getItemAtIndex_2 = List.GetItemAtIndex(list=transpose, index=code_block_16)

getItemAtIndex_3 = List.GetItemAtIndex(list=transpose, index=code_block_15)

# group (continued): Construct flame geometry
scale1D = Geometry.Scale1D(getItemAtIndex_3, translate_5, translate_6, translate_7)
create_3 = List.Create(scale1D, getItemAtIndex_2)
transpose_2 = List.Transpose(create_3)
byUnion = Solid.ByUnion(transpose_2)

# group: Is the current time after 4pm and before 7am (sundown)?
components = DateTime.Components(now)
code_block_17 = CodeBlock { 5; }
sub_3 = components.out3 - code_block_17
code_block_18 = CodeBlock { 16; 7; }
ge = sub_3 >= code_block_18.out0
le = sub_3 <= code_block_18.out1
or_ = Or(ge, le)

# group: Yellow color for flames if sundown is True, or fully transparent (invisible) if False
watch_3 = Watch(or_)
code_block_19 = CodeBlock { 140; 0; }
if_ = If(test=watch_3, true=code_block_19.out0, false=code_block_19.out1)
code_block_20 = CodeBlock { 185; 255; 0; }
byARGB = Color.ByARGB(a=if_, r=code_block_20.out1, g=code_block_20.out1, b=code_block_20.out2)

# group: Flames
byGeometryColor = Display.Display.ByGeometryColor(byUnion, byARGB)

mul_5 = mul_4 * candle_width_factor
byCenterPointRadius_7 = Circle.ByCenterPointRadius(centerPoint=getItemAtIndex, radius=mul_5)

# group: Candle geometry
extrudeAsSolid_3 = Curve.ExtrudeAsSolid(byCenterPointRadius_7, candle_height)
code_block_21 = CodeBlock { 255; 143; 195; 243; }
byARGB_2 = Color.ByARGB(a=code_block_21.out0, r=code_block_21.out1, g=code_block_21.out2, b=code_block_21.out3)
byGeometryColor_2 = Display.Display.ByGeometryColor(extrudeAsSolid_3, byARGB_2)

byOrigin = CoordinateSystem.ByOrigin(translate_4)
code_block_22 = CodeBlock { 0.05; }
byRadiusHeight = Cylinder.ByRadiusHeight(byOrigin, code_block_22, mul_5)
code_block_23 = CodeBlock { 255; 0; }
byARGB_3 = Color.ByARGB(a=code_block_23.out0, r=code_block_23.out1, g=code_block_23.out1, b=code_block_23.out1)
byGeometryColor_3 = Display.Display.ByGeometryColor(byRadiusHeight, byARGB_3)
