# Dynamo graph Filling Wall Regions.dyn (Dynamo 1.2.1.3083)

views = Views("Level 1")
wall_types = WallTypes("Generic - 200mm")
boolean = BoolSelector(true)
wallSuperFilter = Custom[WallSuperFilter](Wall_Types=wall_types, byLevel_True_False=boolean)  # Filter walls by wall types and/or level.
geometry = Element.Geometry(wallSuperFilter)
wall_types_2 = WallTypes("Generic - 90mm Brick")
wallSuperFilter_2 = Custom[WallSuperFilter](Wall_Types=wall_types_2, byLevel_True_False=boolean)
geometry_2 = Element.Geometry(wallSuperFilter_2)
doesIntersect = Geometry.DoesIntersect(geometry=geometry, other=geometry_2, lacing=CrossProduct)
flatten = Flatten(doesIntersect, lacing=Longest)
code_block = CodeBlock { true; }
allIndicesOf = List.AllIndicesOf(list=flatten@L2, item=code_block)
getItemAtIndex = List.GetItemAtIndex(list=geometry_2, index=allIndicesOf)
union = Solid.Union(geometry, getItemAtIndex)
level = Custom[Element.Level](element=wallSuperFilter)  # Gets an element's level
plane = Custom[Level.Plane](level=level)  # Retrieves the plane of a given level
intersect = Geometry.Intersect(geometry=union, other=plane)
perimeterCurves = Surface.PerimeterCurves(intersect)
select_filled_region_type = FilledRegionTypes("Diagonal Crosshatch")
byCurves = FilledRegion.ByCurves(views, perimeterCurves, select_filled_region_type)
