# Dynamo graph Filter_Boolean.dyn (Dynamo 1.3.0.875)

code_block = CodeBlock { Flatten({1001..1038,2001..2038}); }
code_block_2 = CodeBlock { Flatten({1..17,24,25,30,31}); }
true_False = Python(IN[0]=code_block, IN[1]=code_block_2)
# ---------- true_False.python (40 lines) ----------
import clr
clr.AddReference('ProtoGeometry')
from Autodesk.DesignScript.Geometry import *
#The inputs to this node will be stored as a list in the IN variables.
dataEnteringNode = IN

vermesser_NUM = IN[0]
unique_A_NUM = IN[1]


def bool_list(_listLarger, _listSmaller):
  
    true_false = []
    for item in _listLarger:
        if item in _listSmaller:
            true_false.append(True)
            pass
        elif item not in _listSmaller:
            true_false.append(False)

    return true_false

def compare_last_two(_listA,_listB):
 
    filtered_list = []
    
    for i in _listA:
        for j in _listB:
            if j == abs(i)%100:
                filtered_list.append(i)
    return filtered_list

Tower_A_NUM = compare_last_two(vermesser_NUM,unique_A_NUM)
Tower_B_NUM = list(set(vermesser_NUM) - set(Tower_A_NUM))

A_IN_Vermesser = bool_list(vermesser_NUM,Tower_A_NUM)
B_IN_Vermesser = bool_list(vermesser_NUM,Tower_B_NUM)

#Assign your output to the OUT variable.
OUT = A_IN_Vermesser
# ----------------------------------------
filterByBoolMask = List.FilterByBoolMask(list=code_block, mask=true_False)
code_block_3 = CodeBlock { 10; }
group_numbers = Python(IN[0]=filterByBoolMask.in, IN[1]=code_block_3)
# ---------- group_numbers.python (31 lines) ----------
import clr
clr.AddReference('ProtoGeometry')
from Autodesk.DesignScript.Geometry import *
#The inputs to this node will be stored as a list in the IN variables.
dataEnteringNode = IN

def cluster(data, maxgap = 10):
    '''Arrange data into groups where successive elements
       differ by no more than *maxgap*

        >>> cluster([1, 6, 9, 100, 102, 105, 109, 134, 139], maxgap=10)
        [[1, 6, 9], [100, 102, 105, 109], [134, 139]]

        >>> cluster([1, 6, 9, 99, 100, 102, 105, 134, 139, 141], maxgap=10)
        [[1, 6, 9], [99, 100, 102, 105], [134, 139, 141]]

    '''
    data.sort()
    groups = [[data[0]]]
    for x in data[1:]:
        if abs(x - groups[-1][-1]) <= maxgap:
            groups[-1].append(x)
        else:
            groups.append([x])
    return groups

numbers = IN[0]
look_for = IN[1]

#Assign your output to the OUT variable.
OUT = cluster(numbers, look_for)
# ----------------------------------------
groupByFunction = GroupByFunction()  # unwired: arg0, arg1
categories = Categories("GenericAnnotation")
watch = Watch(categories)
all_elements_of_category = ElementsOfCategory(categories)
code_block_4 = CodeBlock { "Name"; }
getParameterValueByName = Element.GetParameterValueByName(element=all_elements_of_category, parameterName=code_block_4)
group_numbers_2 = Python(IN[0]=getParameterValueByName, IN[1]=code_block_3)  # same code as group_numbers
python_script = Python(IN[0]=getParameterValueByName)
# ---------- python_script.python (17 lines) ----------
import clr
clr.AddReference('ProtoGeometry')
from Autodesk.DesignScript.Geometry import *
#The inputs to this node will be stored as a list in the IN variables.
dataEnteringNode = IN

def first_two(_list, num_digits = 2):
	empty_list = []
	for num in _list:
		empty_list.append(str(num)[:num_digits])
	
	return empty_list
		
req_data = IN[0]

#Assign your output to the OUT variable.
OUT = first_two(req_data)
# ----------------------------------------
groupByKey = List.GroupByKey(list=all_elements_of_category, keys=python_script)
