# Dynamo graph FunctionComposeApplyEg.dyn (Dynamo 2.0.3.8810)

code_block = CodeBlock { 10; }
add = code_block + _  # unwired: y
mul = code_block * _  # unwired: y
eq = code_block == _  # unwired: y
function_compose = ComposeFunctions(func0=mul, func1=eq)  # unwired: func2
code_block_2 = CodeBlock { 2; 3; 4; }
function_apply = ApplyFunction(func=function_compose, arg1=code_block_2.out0)
restOfItems = List.RestOfItems(list=function_apply)
reverse = List.Reverse(list=restOfItems)
div = _ / code_block  # unwired: x
