# Dynamo graph Hatch.dyn (Dynamo 1.3.0.645)

# group: Geometry Facets
code_block = CodeBlock { 8; }
boolean = BoolSelector(true)
sphere = Autodesk.Dynamo.MeshToolkit.Mesh.Sphere(arg2=code_block, arg3=boolean)
triangles = Autodesk.Dynamo.MeshToolkit.Mesh.Triangles(sphere)

# group: Make surfaces disappear, but still obscure background
code_block_2 = CodeBlock { a=DSCore.Color.ByARGB(255,250,250,250); {a,a}; }
bySurfaceColors = Display.Display.BySurfaceColors(triangles, code_block_2.out1)

# group: Light Vector
code_block_3 = CodeBlock { Vector.ByCoordinates(0,0.5,-1); }

# group: Surface normals mapped to line densities
normalAtParameter = Surface.NormalAtParameter(surface=triangles)
dot = Vector.Dot(normalAtParameter, code_block_3)
code_block_4 = CodeBlock { 3; 40; }
remapRange = Math.RemapRange(numbers=dot, newMin=code_block_4.out0, newMax=code_block_4.out1)
code_block_5 = CodeBlock(n=remapRange) { 1..0..#n; }
restOfItems = List.RestOfItems(code_block_5@L2)

# group: Random isoline directions on faces
count = Count(triangles)
randomList = Math.RandomList(count)
getIsoline = Surface.GetIsoline(triangles, randomList, restOfItems)
intersect = Geometry.Intersect(geometry=getIsoline, other=triangles)

# group: Intersect lines on facets
length = Curve.Length(intersect)
isNull = Object.IsNull(length)
filterByBoolMask = List.FilterByBoolMask(list=intersect, mask=isNull)
code_block_6 = CodeBlock(x=filterByBoolMask.out) { x; }
