# Dynamo graph Image Sampling.dyn (Dynamo 1.3.1.1736)

element_types = ElementTypes("DividedSurface")
all_elements_of_type = ElementsOfType(element_types)
geometry = Element.Geometry(all_elements_of_type)
firstItem = List.FirstItem(geometry)
string = StringInput("Mesh")
removeIfNot = RemoveIfNot(firstItem, string)
vertexPositions = Mesh.VertexPositions(removeIfNot)
byPoints = Polygon.ByPoints(vertexPositions)
byPatch = Surface.ByPatch(byPoints)
file_path = Filename(".\Image.png")
fromPath = FileObject(file_path)  # "File.FromPath"
readFromFile = Image.ReadFromFile(fromPath)
watch_image = WatchImageCore(readFromFile)
string_2 = StringInput("Number")
getParameterValueByName = Element.GetParameterValueByName(element=all_elements_of_type, parameterName=string_2)
pixels = Image.Pixels(image=watch_image, xSamples=getParameterValueByName, ySamples=getParameterValueByName)
reverse = List.Reverse(pixels, lacing=Longest)
flatten = Flatten(reverse)
reverse_2 = List.Reverse(flatten, lacing=Longest)
byGeometryColor = Display.Display.ByGeometryColor(byPatch, reverse_2)
watch_3d = Watch3D(byGeometryColor)
