# Dynamo graph LearnDynamo_Module_7-1.dyn (Dynamo 1.0.0.1180)

categories = Categories("Walls")
all_elements_of_category = ElementsOfCategory(categories)

# group: Select Void Family
family_types = FamilyTypes("VoidFamily:VoidFamily")

# note: LearnDynamo - Module 7
# Void by IFC
# Revit Version - 2016
# Dynamo Version 1.0
# Script Version 1.0
boolean = BoolSelector(true)
python_script = Python(IN[0]=boolean)
# ---------- python_script.python (28 lines) ----------
#Copyright(c) 2016 www.Learndynamo.com 
#Please contact at jeremy@learndynamo.com

import clr
clr.AddReference('RevitAPI')
clr.AddReference("RevitNodes")

import Revit
import Autodesk
from Autodesk.Revit.DB import *

clr.AddReference("RevitServices")
import RevitServices
from RevitServices.Persistence import DocumentManager
from RevitServices.Transactions import TransactionManager
doc = DocumentManager.Instance.CurrentDBDocument

toggle = IN[0]
lst = []

if toggle == True:

	coll = FilteredElementCollector(doc).OfClass(RevitLinkInstance).ToElements()

	OUT = coll[0].GetLinkDocument()
	
else:
	OUT = "Set toggle to True."
# ----------------------------------------
categories_2 = Categories("StructuralFramingSystem")
python_script_2 = Python(IN[0]=python_script, IN[1]=categories_2)
# ---------- python_script_2.python (24 lines) ----------
#Copyright(c) 2016 www.Learndynamo.com 
#Please contact at jeremy@learndynamo.com

import clr
clr.AddReference('RevitAPI')
clr.AddReference("RevitNodes")

import Revit
import Autodesk
from Autodesk.Revit.DB import *

clr.AddReference("RevitServices")
import RevitServices
from RevitServices.Persistence import DocumentManager
from RevitServices.Transactions import TransactionManager
doc = DocumentManager.Instance.CurrentDBDocument

link = UnwrapElement(IN[0])
category = UnwrapElement(IN[1])

fil = ElementCategoryFilter(category.Id)
coll = FilteredElementCollector(link).WherePasses(fil).WhereElementIsNotElementType().ToElements()
	
OUT = coll	
# ----------------------------------------
geometry = Element.Geometry(python_script_2)
flatten = Flatten(geometry)
geometry_2 = Element.Geometry(all_elements_of_category)
flatten_2 = Flatten(geometry_2)
python_script_3 = Python(IN[0]=flatten, IN[1]=flatten_2)
# ---------- python_script_3.python (36 lines) ----------
#Copyright(c) 2016 www.Learndynamo.com 
#Please contact at jeremy@learndynamo.com

import clr
clr.AddReference("RevitAPI")
import Autodesk
from Autodesk.Revit.DB import *

clr.AddReference('ProtoGeometry')
from Autodesk.DesignScript.Geometry import *
clr.AddReference("RevitServices")
import RevitServices
from RevitServices.Persistence import DocumentManager
from RevitServices.Transactions import TransactionManager

clr.AddReference("RevitNodes")
import Revit
clr.ImportExtensions(Revit.Elements)
clr.ImportExtensions(Revit.GeometryConversion)
doc =  DocumentManager.Instance.CurrentDBDocument

linkedSolids = IN[0]
wallSols = IN[1]

lst = []

for i in linkedSolids:

	for j in wallSols:

		intcheck = i.DoesIntersect(j)
		if intcheck == True:
			check = j.Intersect(i)
			lst.append(check)

OUT = lst
# ----------------------------------------
flatten_3 = Flatten(python_script_3)
boundingBox = Element.BoundingBox(flatten_3)
maxPoint = BoundingBox.MaxPoint(boundingBox)
minPoint = BoundingBox.MinPoint(boundingBox)
byStartPointEndPoint = Line.ByStartPointEndPoint(startPoint=maxPoint, endPoint=minPoint)
code_block = CodeBlock { 0.5; }
pointAtParameter = Curve.PointAtParameter(curve=byStartPointEndPoint, param=code_block)
byPoint = FamilyInstance.ByPoint(familyType=family_types, point=pointAtParameter)
code_block_2 = CodeBlock { "Width"; "Length"; "Height"; }
flatten_4 = Flatten(maxPoint)
X = Point.X(flatten_4)
flatten_5 = Flatten(minPoint)
X_2 = Point.X(flatten_5)
sub = X - X_2
round = Math.Round(sub)
flatten_6 = Flatten(round)

# group: Void Parameters
# note: Depth
number_slider = DoubleSlider(100, range=0..500 step 0.1)
# note: Width
number_slider_2 = DoubleSlider(100, range=0..500 step 0.1)
# note: Height
number_slider_3 = DoubleSlider(100, range=0..400 step 0.1)

add = flatten_6 + number_slider
setParameterByName = Element.SetParameterByName(element=byPoint, parameterName=code_block_2.out0, value=add)
Y = Point.Y(flatten_4)
Y_2 = Point.Y(flatten_5)
sub_2 = Y - Y_2
round_2 = Math.Round(sub_2)
flatten_7 = Flatten(round_2)
add_2 = flatten_7 + number_slider_2
setParameterByName_2 = Element.SetParameterByName(element=setParameterByName, parameterName=code_block_2.out1, value=add_2)
Z = Point.Z(flatten_4)
Z_2 = Point.Z(flatten_5)
sub_3 = Z - Z_2
round_3 = Math.Round(sub_3)
flatten_8 = Flatten(round_3)
add_3 = flatten_8 + number_slider_3
setParameterByName_3 = Element.SetParameterByName(element=setParameterByName_2, parameterName=code_block_2.out2, value=add_3)
end = Revit.Transaction.Transaction.End(setParameterByName_3)
explode = Geometry.Explode(flatten_3)
code_block_3 = CodeBlock { 0.5; }
pointAtParameter_2 = Surface.PointAtParameter(surface=explode, u=code_block_3, v=code_block_3)
normalAtPoint = Surface.NormalAtPoint(surface=explode, point=pointAtParameter_2)
python_script_4 = Python(IN[0]=explode, IN[1]=normalAtPoint)
# ---------- python_script_4.python (45 lines) ----------
#Copyright(c) 2016 www.Learndynamo.com 
#Please contact at jeremy@learndynamo.com

import clr
clr.AddReference("RevitAPI")
import Autodesk
from Autodesk.Revit.DB import *
clr.AddReference('ProtoGeometry')
from Autodesk.DesignScript.Geometry import *

clr.AddReference("RevitServices")
import RevitServices
from RevitServices.Persistence import DocumentManager
from RevitServices.Transactions import TransactionManager

clr.AddReference("RevitNodes")
import Revit
clr.ImportExtensions(Revit.Elements)
clr.ImportExtensions(Revit.GeometryConversion)
from System.Collections.Generic import *

doc =  DocumentManager.Instance.CurrentDBDocument

surfaces = IN[0]
vectLines= IN[1]

lst = []

for i, j in zip(surfaces, vectLines):
	hi = 9999
	lowSurf = None
	
	for surf, vect in zip(i, j):
		p = surf.PointAtParameter(0.5,0.5)
		pZ = p.Z
		vect = vect.ToXyz()
		vZ = vect.Z
		
		if pZ < hi and vZ<-0.1:
			hi = pZ
			lowSurf = surf
	
	lst.append(lowSurf)

OUT = lst
# ----------------------------------------
perimeterCurves = Surface.PerimeterCurves(python_script_4)
byOriginNormal = Plane.ByOriginNormal()
pullOntoPlane = Curve.PullOntoPlane(curve=perimeterCurves, plane=byOriginNormal)
startPoint = Curve.StartPoint(pullOntoPlane)
byPoints = Polygon.ByPoints(startPoint)
center = Polygon.Center(byPoints)
YAxis = Vector.YAxis()
code_block_4 = CodeBlock { 1000; }
translate = Geometry.Translate(geometry=center, direction=YAxis, distance=code_block_4)
byTwoPoints = Vector.ByTwoPoints(start=center, end=translate)
firstItem = List.FirstItem()
map = List.Map(list=pullOntoPlane, f_x=firstItem)
code_block_5 = CodeBlock { 0.5; }
pointAtParameter_3 = Curve.PointAtParameter(curve=map, param=code_block_5)
byTwoPoints_2 = Vector.ByTwoPoints(start=center, end=pointAtParameter_3)
angleWithVector = Vector.AngleWithVector(vector=byTwoPoints, otherVector=byTwoPoints_2)
setRotation = FamilyInstance.SetRotation(familyInstance=end, degree=angleWithVector)
python_script_5 = Python(IN[0]=all_elements_of_category, IN[1]=setRotation)
# ---------- python_script_5.python (35 lines) ----------
#Produced by Jeremy Graham, Copyright(c) 2015
#Please contact at jeremy.graham@live.com.au

import clr
clr.AddReference('RevitAPI')
from Autodesk.Revit.DB import *
clr.AddReference("RevitServices")
clr.AddReference("ProtoGeometry")
from Autodesk.DesignScript.Geometry import *
import RevitServices
from RevitServices.Persistence import DocumentManager
from RevitServices.Transactions import TransactionManager

doc = DocumentManager.Instance.CurrentDBDocument

eletocut = UnwrapElement(IN[0])
voids = UnwrapElement(IN[1])

output = []

for i in eletocut:	
			
	for j in voids:

		try:
			TransactionManager.Instance.EnsureInTransaction(doc)
			InstanceVoidCutUtils.AddInstanceVoidCut(doc, i, j)
			output.append("ok")
			TransactionManager.Instance.TransactionTaskDone()

		except:
			output.append("Oops")
			pass

OUT =  output
# ----------------------------------------
