# Dynamo graph MergeTwoJsonObjects.dyn (Dynamo 2.0.3.8810)

file_path = Filename("..\..\Git_RG\Dynamo-Examples_Snippets\Dynamo_Examples\MergeTwoJsonObjects\Revit_CAT_ENG_dict.json")
fromJsonFile = JsonData.Utilities.Read.FromJsonFile(filepath=file_path)
jsonToString = JsonData.Utilities.Parse.JsonToString(jsonObjects=fromJsonFile)
file_path_2 = Filename("..\..\Git_RG\Dynamo-Examples_Snippets\Dynamo_Examples\MergeTwoJsonObjects\Revit_CAT_DEU_dict.json")
fromJsonFile_2 = JsonData.Utilities.Read.FromJsonFile(filepath=file_path_2)
jsonToString_2 = JsonData.Utilities.Parse.JsonToString(jsonObjects=fromJsonFile_2)
update_json_objects = Python(IN[0]=jsonToString, IN[1]=jsonToString_2)
# ---------- update_json_objects.python (24 lines) ----------
import clr
clr.AddReference("JsonData")
from JsonData.Utilities import Parse

import sys
sys.path.append(r"C:\Program Files (x86)\IronPython 2.7\Lib")
import json

eng = IN[0]
ger = IN[1]

en_dicts = json.loads(eng)
de_dicts = json.loads(ger)


for key,value in en_dicts.items():
	new_value = de_dicts[key]
	new_name = new_value["Name"]
	en_dicts[key].update({"DeutschName": new_name})
	
data = json.dumps(en_dicts, ensure_ascii=False)


OUT = Parse.String(data)
# ----------------------------------------
watch = Watch(update_json_objects)
file_path_3 = Filename("..\..\Git_RG\Dynamo-Examples_Snippets\Dynamo_Examples\MergeTwoJsonObjects\Revit_CAT_MERGED_dict.json")
toJsonFile = JsonData.Utilities.Write.ToJsonFile(jsonObjects=update_json_objects, filepath=file_path_3)
