# Dynamo graph Parameter Name.dyn (Dynamo 1.3.1.1736)

file_path = Filename("C:\Users\RGovindarajan\Desktop\Aufzug_Parameters.txt")
code_block = CodeBlock { Category.ByName("Specialty Equipment"); }
all_elements_of_category = ElementsOfCategory(code_block)
code_block_2 = CodeBlock(a=all_elements_of_category) { a[0]; }
parameters = Element.Parameters(code_block_2)
name = Parameter.Name(parameters)
sort = List.Sort(name)
code_block_3 = CodeBlock { "Type"; }
getParameterValueByName = Element.GetParameterValueByName(element=code_block_2, parameterName=code_block_3)
parameters_2 = Element.Parameters(getParameterValueByName)
name_2 = Parameter.Name(parameters_2)
sort_2 = List.Sort(name_2)
create = List.Create(sort, sort_2)
flatten = Flatten(create)
python_script = Python(IN[0]=flatten)
# ---------- python_script.python (3 lines) ----------
data = IN[0]

OUT = "; ".join(data)
# ----------------------------------------
writeText = File.WriteText(file_path, python_script)
