# Dynamo graph Place Views on Sheet.dyn (Dynamo 1.3.0.875)

# group: Get Sheet By Name
getAllSheets = Custom[GetAllSheets]()  # Gets all Sheets in the project.
sheetNumber = Sheet.SheetNumber(getAllSheets)
code_block = CodeBlock { "S-3.1"; }
eq = sheetNumber == code_block
filterByBoolMask = List.FilterByBoolMask(list=getAllSheets, mask=eq)

# group: Get Views By Name
code_block_2 = CodeBlock { {"1","2","3"}; false; }
code_block_3 = CodeBlock(ViewNames=code_block_2.out0, DoesContain=code_block_2.out1, IsViewTemplate=code_block_2.out1) { ViewNames; DoesContain; IsViewTemplate; }
get_view_by_name_py = Python(IN[0]=code_block_3.ViewNames, IN[1]=code_block_3.DoesContain, IN[2]=code_block_3.IsViewTemplate)
# ---------- get_view_by_name_py.python (69 lines) ----------
#For more information refer to RBG Wiki or email me (ctrl + click link): daniel.woodcock@robertbird.com

import clr
clr.AddReference("RevitNodes")
import Revit
clr.ImportExtensions(Revit.Elements)

# Import DocumentManager and TransactionManager
clr.AddReference("RevitServices")
import RevitServices
from RevitServices.Persistence import DocumentManager
from RevitServices.Transactions import TransactionManager
doc = DocumentManager.Instance.CurrentDBDocument
uidoc = DocumentManager.Instance.CurrentUIDocument

# Import RevitAPI
clr.AddReference("RevitAPI")
import Autodesk
from Autodesk.Revit.DB import *

import System
from System.Collections.Generic import *

import sys
pyt_path = r'C:\Program Files (x86)\IronPython 2.7\Lib'
sys.path.append(pyt_path)

def tolist(obj1):
	if hasattr(obj1,"__iter__"): return obj1
	else: return [obj1]

names = tolist(IN[0])
cont = tolist(IN[1])
cont = cont[0]
isVTemp = tolist(IN[2])
isVTemp = isVTemp[0]

fec = FilteredElementCollector(doc)
fec = fec.OfClass(View)

outList = []

for name in names:
	found = None
	for view in fec:
		v = UnwrapElement(view)	
		if not isVTemp:
			if not v.IsTemplate:			
				if cont:
					if name in v.Name:
						found = v
						break
				else:
					if v.Name == name:
						found = v
						break
		else:
			if v.IsTemplate:				
				if cont:
					if name in v.Name:
						found = v
						break
				else:
					if v.Name == name:
						found = v
						break
	outList.append(found)
	
OUT = outList
# ----------------------------------------

# group: Create Some Points
number_slider = DoubleSlider(181.374, range=0..1000 step 0.001)
number_slider_2 = DoubleSlider(212.882, range=0..1000 step 0.001)
byCoordinates = Point.ByCoordinates(x=number_slider, y=number_slider_2)
number_slider_3 = DoubleSlider(510.466, range=0..1000 step 0.001)
number_slider_4 = DoubleSlider(468.222, range=0..1000 step 0.001)
byCoordinates_2 = Point.ByCoordinates(x=number_slider_3, y=number_slider_4)
number_slider_5 = DoubleSlider(176.372, range=0..1000 step 0.001)
number_slider_6 = DoubleSlider(426.468, range=0..1000 step 0.001)
byCoordinates_3 = Point.ByCoordinates(x=number_slider_5, y=number_slider_6)
create = List.Create(byCoordinates, byCoordinates_2, byCoordinates_3)

# group: Place Views on a Sheet
run = BoolSelector(false)
code_block_4 = CodeBlock(Run=run, Sheet=filterByBoolMask.in, Views=get_view_by_name_py, Locations=create) { Run; Sheet; Views; Locations; }
place_views_on_sheet_py = Python(IN[0]=code_block_4.Run, IN[1]=code_block_4.Sheet, IN[2]=code_block_4.Views, IN[3]=code_block_4.Locations)
# ---------- place_views_on_sheet_py.python (55 lines) ----------
################### Import References ###################
import clr

clr.AddReference("RevitServices")
import RevitServices
from RevitServices.Persistence import DocumentManager
from RevitServices.Transactions import TransactionManager
doc =  DocumentManager.Instance.CurrentDBDocument
app = DocumentManager.Instance.CurrentUIApplication.Application

clr.AddReference("RevitNodes")
import Revit
clr.ImportExtensions(Revit.Elements)
clr.ImportExtensions(Revit.GeometryConversion)

clr.AddReference("RevitAPI")
from Autodesk.Revit.DB import *
################### Definitions ###################
def tolist(obj1):
	if hasattr(obj1,"__iter__"): return obj1
	else: return [obj1]
################### Inputs ###################
#get the bool in port IN[0]...
r = tolist(IN[0])
r = r[0]
#get the sheet in port IN[1] and UnwrapElement if not already...
sht = tolist(UnwrapElement(IN[1]))
#ensure only one sheet is passed (Multiple Sheets not allowed in this example)...
sht = sht[0]
#get the views in port IN[1] and UnwrapElement if not already...
views = tolist(UnwrapElement(IN[2]))
#get the points in port IN[2] (no need to unwrap as these are Dynamo Points)...
locs = tolist(IN[3])

################### Outputs ###################
outList = []

################### Script ###################
if r:
	if len(views) == len(locs):
		for v,l in zip(views, locs):
			TransactionManager.Instance.EnsureInTransaction(doc)
			try:
				if Viewport.CanAddViewToSheet(doc,sht.Id,v.Id):
					vp = Viewport.Create(doc,sht.Id,v.Id,l.ToXyz())
					outList.append(vp)
			except Exception, e:
				outList.append(e.message)
			TransactionManager.Instance.TransactionTaskDone()
		OUT = outList
	else:
		OUT = "Number of Views must match the number of Locations"
else:
	OUT = "Set Run to True"
	
# ----------------------------------------

# group: Preview Outlines for placement
code_block_5 = CodeBlock(views=filterByBoolMask.in) { views; }
# note: Gets Sheet Outline for visualisation
get_view_outlines_py = Python(IN[0]=code_block_5)
# ---------- get_view_outlines_py.python (56 lines) ----------
################### Import References ###################
import clr

clr.AddReference("ProtoGeometry")
from Autodesk.DesignScript import Geometry as geom
clr.AddReference("RevitServices")
import RevitServices
from RevitServices.Persistence import DocumentManager
from RevitServices.Transactions import TransactionManager
doc =  DocumentManager.Instance.CurrentDBDocument
app = DocumentManager.Instance.CurrentUIApplication.Application

clr.AddReference("RevitNodes")
import Revit
clr.ImportExtensions(Revit.Elements)
clr.ImportExtensions(Revit.GeometryConversion)

clr.AddReference("RevitAPI")
from Autodesk.Revit.DB import *

import System
from System.Collections.Generic import *
################### Definitions ###################
def tolist(obj1):
	if hasattr(obj1,"__iter__"): return obj1
	else: return [obj1]
################### Input Variables ###################
#get the sheet in port IN[1] and UnwrapElement if not already...
views = tolist(UnwrapElement(IN[0]))
################### Output Variables ###################
outList = []
################### other Variables ###################
#conversion between ft and mm
ft2mm = 304.8
################### Script ###################
for v in views:
	#get outline
	oLine = v.Outline
	minU = oLine.Min.U*304.8
	minV = oLine.Min.V*304.8
	maxU = oLine.Max.U*304.8
	maxV = oLine.Max.V*304.8
	
	#get width and length of Rectangle
	w = maxU-minU
	l = maxV-minV
	
	#create rectangle
	myRec = geom.Rectangle.ByWidthLength(w,l)
	#move rectangle so bottom left corner is at origin
	myRec2 = geom.Geometry.Translate(myRec,w/2,l/2,0)
	#add rectangle to output list
	outList.append(myRec2)

OUT = outList
	
# ----------------------------------------
code_block_6 = CodeBlock(views=get_view_by_name_py) { views; }
# note: Moves view outlines to placement points for visualisation
get_view_outlines_py_2 = Python(IN[0]=code_block_6)  # same code as get_view_outlines_py
center = Polygon.Center(get_view_outlines_py_2)
byTwoPoints = Vector.ByTwoPoints(start=center, end=create)
translate = Geometry.Translate(geometry=get_view_outlines_py_2, direction=byTwoPoints)
