# Dynamo graph Print Output.dyn (Dynamo 1.3.0.875)

file_path = Filename("C:\Users\RGovindarajan\Desktop\test.xlsx")
fromPath = FileObject(file_path)  # "File.FromPath"
code_block = CodeBlock { "Tabelle1"; }
code_block_2 = CodeBlock { null; true; false; }
code_block_3 = CodeBlock(y=code_block_2.out0) { List.UniqueItems(Flatten(x!=y)); }  # unwired: x
if_ = If(test=code_block_3, true=code_block_2.out1, false=code_block_2.out2)
boolean = BoolSelector(false)
python_script = Python()  # unwired: IN[0]
# ---------- python_script.python (13 lines) ----------
import sys
sys.path.append(r'C:\Program Files (x86)\IronPython 2.7\Lib')
from StringIO import StringIO
output = StringIO()
sys.stdout = output

print('Starting Test')
print('=============')
print('1')
print('2')
print('3')

OUT = output.getvalue()
# ----------------------------------------
watch = Watch(python_script)
readFromFile = Excel.ReadFromFile()  # unwired: file, sheetName
python_script_2 = Python(IN[0]=readFromFile)
# ---------- python_script_2.python (35 lines) ----------
from System.IO import Directory
import sys
sys.path.append('C:\Program Files (x86)\IronPython 2.7\Lib')

import clr
clr.AddReferenceByName('Microsoft.Office.Interop.Excel, Version=11.0.0.0, Culture=neutral, PublicKeyToken=71e9bce111e9429c')
from Microsoft.Office.Interop import Excel
from Microsoft.Office.Interop.Excel import ApplicationClass
from System.Runtime.InteropServices import Marshal


def bool_check(data):
    if type(data) is str:
        check1 = False
    else:
        check1 = True

    return check1


def excel_close(_bool):
    if _bool:
        xlApp = Marshal.GetActiveObject("Excel.Application")
        xlApp.Visible = True
        xlApp.DisplayAlerts = False
        xlApp.Workbooks.Close()
        xlApp.Quit()
        Check =  "Success"
    else:
        Check = "Excel file is not opened yet"

    return Check

true_false = bool_check(IN[0])
OUT = excel_close(true_false)
# ----------------------------------------
