# Dynamo custom node Refresh Time.dyf (Dynamo 1.2.0.2831)
# category: Revit.Application
# Custom Time Hack

Boolean = Input()
python_script = Python(IN[0]=Boolean)
# ---------- python_script.python (6 lines) ----------
import time
x = IN[0]
if x == True:
	OUT = time.clock()
else:
	OUT = time.clock()
# ----------------------------------------
random = Math.Random(python_script)
Output = Output(random)  # ""
