# Dynamo custom node Rename Files.dyf (Dynamo 2.1.0.5357)
# category: archilab.Revit.Printing
# This node will use an "identifier" to pick out files from a supplied directory to rename files to a new name supplied. Please make sure to match list lengths of identifier and new name inputs.

DirectoryPath = Input(DirectoryPath: string = "")
Identifiers_string_var = Input(Identifiers:string=var[]: var[]..[])
NewNames_string_var = Input(NewNames: string=var[]: var[]..[])
RunIt = Input(RunIt: bool = false)
python_script = Python(IN[0]=DirectoryPath, IN[1]=Identifiers_string_var, IN[2]=NewNames_string_var, IN[3]=RunIt)
# ---------- python_script.python (39 lines) ----------
# Copyright(c) 2016, Konrad Sobon
# @arch_laboratory, http://archi-lab.net

import sys
pyt_path = r'C:\Program Files (x86)\IronPython 2.7\Lib'
sys.path.append(pyt_path)

import os

filePath = IN[0]
identifiers = IN[1]
newNames = IN[2]
RunIt = IN[3]

files = os.listdir(filePath)

if RunIt:
	try:
		errorReport = None
		for file in files:
			currentFileName = filePath + "\\" + file
		
			for i, j in zip(identifiers, newNames):
				newFileName = filePath + "\\" + j
	
				if i in file and currentFileName != newFileName:
					os.rename(currentFileName, newFileName)
	except:
		# if error accurs anywhere in the process catch it
		import traceback
		errorReport = traceback.format_exc()
else:
	errorReport = "Set RunMe to True."

#Assign your output to the OUT variable
if errorReport == None:
	OUT = newFileName
else:
	OUT = errorReport
# ----------------------------------------
OUT = Output(python_script)
