# Dynamo graph SecondHand.dyn (Dynamo 1.3.0.645)

byCoordinates = Point.ByCoordinates()
byCenterPointRadius = Circle.ByCenterPointRadius()
now = DateTime.Now()
string_from_object = FromObject(now)
code_block = CodeBlock { ":"; }
lastIndexOf = String.LastIndexOf(string_from_object, code_block)
code_block_2 = CodeBlock(x=lastIndexOf) { x+1; }
code_block_3 = CodeBlock { 2; }
substring = String.Substring(str=string_from_object, startIndex=code_block_2, length=code_block_3)
toNumber = String.ToNumber(substring)
code_block_4 = CodeBlock(x=toNumber) { -x/60; }
pointAtParameter = Curve.PointAtParameter(curve=byCenterPointRadius, param=code_block_4)
code_block_5 = CodeBlock { 0.05; 0.01; }
byPointsRadii = Cone.ByPointsRadii(byCoordinates, pointAtParameter, code_block_5.out0, code_block_5.out1)
