# Dynamo graph SetGridExtents01.dyn (Dynamo 1.3.3.4111)

# group: ANNOTATION
# note: USE:
# FOR COMMENTS AND IMPORTANT INFO
# note: ANNOTATION

# group: CONTROL
# note: USE:
# FOR VARIABLE CONTROL INPUTS
# SUCH AS SLIDERS
# note: CONTROL

# group: MONITOR
# note: USE:
# FOR IMPORTANT WATCH NODES
# note: MONITOR

# group: INPUT
# note: USE:
# FOR FIXED INPUTS SUCH AS FILE PATHS
# note: INPUT

# group: TO REVIT
# note: USE:
# FOR NODE BLOCKS THAT EXPORTS GEOMETRY
# AND PARAMETERS TO REVIT
# note: TO REVIT

# group: Shortest Path
# note: DYNAMO VERSION: DYNAMO 1.3
# PACKAGES REQUIRED TO RUN:
# - SPRING NODES
# - LUNCHBOX

# group: Select Grids to modify
select_model_elements = DSModelElementsSelection()  # 6 picked in the model

views = Views("Level 1")
getCropBox = Rhythm.Revit.Views.ViewPlan.GetCropBox(views)
flatten = Flatten(getCropBox.out1)
boolean = BoolSelector(true)
python_script = Python(IN[0]=select_model_elements, IN[1]=views, IN[2]=boolean)
# ---------- python_script.python (46 lines) ----------
import clr
clr.AddReference('ProtoGeometry')
from Autodesk.DesignScript.Geometry import *

# Import DocumentManager and TransactionManager
clr.AddReference("RevitServices")
import RevitServices
from RevitServices.Persistence import DocumentManager
from RevitServices.Transactions import TransactionManager

# Import RevitAPI
clr.AddReference("RevitAPI")
import Autodesk
from Autodesk.Revit.DB import *

clr.AddReference("RevitNodes")
import Revit
clr.ImportExtensions(Revit.GeometryConversion)


doc = DocumentManager.Instance.CurrentDBDocument
uiapp = DocumentManager.Instance.CurrentUIApplication
app = uiapp.Application


grids = UnwrapElement(IN[0])
view = UnwrapElement(IN[1])

gridCurves = []
curves = []


for g in grids:
	gridCurves.append(g.GetCurvesInView(DatumExtentType.ViewSpecific, view))

for i in range(0,len(gridCurves)):
	for c in gridCurves[i]:
		start = c.GetEndPoint(0)
		end = c.GetEndPoint(1)
		curves.append(Line.CreateBound(start,end).ToProtoType())

#Assign your outputs to the OUT variable
if IN[2]:
	OUT = curves
else:
	OUT = curves
# ----------------------------------------
code_block = CodeBlock(curve=python_script) { curve[0]; }
startPoint = Curve.StartPoint(code_block)
byOriginNormal = Plane.ByOriginNormal(origin=startPoint)
pullOntoPlane = Curve.PullOntoPlane(curve=flatten, plane=byOriginNormal)
intersectAll = Geometry.IntersectAll(geometry=pullOntoPlane@L1, others=python_script, lacing=CrossProduct)
flatten_2 = Flatten(intersectAll@L3)
transpose = List.Transpose(flatten_2)
deconstruct = List.Deconstruct(list=transpose@L2)
byStartPointEndPoint = Line.ByStartPointEndPoint(startPoint=deconstruct.first, endPoint=deconstruct.rest)
flatten_3 = Flatten(byStartPointEndPoint)
endPoint = Curve.EndPoint(flatten_3)
startPoint_2 = Curve.StartPoint(flatten_3)

# group: Invert start and end point to change head position
python_script_2 = Python(IN[0]=endPoint, IN[1]=startPoint_2)
# ---------- python_script_2.python (36 lines) ----------
import clr
clr.AddReference('ProtoGeometry')
from Autodesk.DesignScript.Geometry import *

# Import DocumentManager and TransactionManager
clr.AddReference("RevitServices")
import RevitServices
from RevitServices.Persistence import DocumentManager
from RevitServices.Transactions import TransactionManager

# Import RevitAPI
clr.AddReference("RevitAPI")
import Autodesk
from Autodesk.Revit.DB import *

clr.AddReference("RevitNodes")
import Revit
clr.ImportExtensions(Revit.GeometryConversion)


doc = DocumentManager.Instance.CurrentDBDocument
uiapp = DocumentManager.Instance.CurrentUIApplication
app = uiapp.Application


startPts = UnwrapElement(IN[0])
endPts = UnwrapElement(IN[1])
revitCurves = []

  
for i in range(0,len(startPts)):
	newLine = Line.CreateBound(startPts[i].ToXyz(),endPts[i].ToXyz())
	revitCurves.append(newLine)
    
#Assign your outputs to the OUT variable
OUT = revitCurves
# ----------------------------------------

code_block_2 = CodeBlock(grids=select_model_elements, view=views, crvs=python_script_2) { grids; view; crvs; }
python_script_3 = Python(IN[0]=code_block_2.grids, IN[1]=code_block_2.view, IN[2]=code_block_2.crvs)
# ---------- python_script_3.python (44 lines) ----------
import clr
clr.AddReference('ProtoGeometry')
from Autodesk.DesignScript.Geometry import *

# Import DocumentManager and TransactionManager
clr.AddReference("RevitServices")
import RevitServices
from RevitServices.Persistence import DocumentManager
from RevitServices.Transactions import TransactionManager

# Import RevitAPI
clr.AddReference("RevitAPI")
import Autodesk
from Autodesk.Revit.DB import *

clr.AddReference("RevitNodes")
import Revit
clr.ImportExtensions(Revit.GeometryConversion)


doc = DocumentManager.Instance.CurrentDBDocument
uiapp = DocumentManager.Instance.CurrentUIApplication
app = uiapp.Application


grids = UnwrapElement(IN[0])
view = UnwrapElement(IN[1])
crvs = UnwrapElement(IN[2])

curves = []
curvesViews = []

TransactionManager.Instance.EnsureInTransaction(doc)

for i in range(0,len(grids)):	
	grids[i].SetCurveInView(DatumExtentType.ViewSpecific,view,crvs[i])


TransactionManager.Instance.TransactionTaskDone()
	

	
#Assign your outputs to the OUT variable
OUT = grids
# ----------------------------------------
