# Dynamo graph ShortestWalk_withMeshToolkit.dyn (Dynamo 1.2.1.3083)

# group: Warped Circular domain
code_block = CodeBlock { 10; }
byCenterPointRadius = Circle.ByCenterPointRadius(radius=code_block)
code_block_2 = CodeBlock { 0..1..#100; }
pointAtParameter = Curve.PointAtParameter(curve=byCenterPointRadius, param=code_block_2)
restOfItems = List.RestOfItems(pointAtParameter)
deconstruct = List.Deconstruct(list=restOfItems)
code_block_3 = CodeBlock { 0.001; }
translate = Geometry.Translate(geometry=deconstruct.first, zTranslation=code_block_3)
join = List.Join(translate, deconstruct.rest)
code_block_4 = CodeBlock { true; }
byPoints = PolyCurve.ByPoints(points=join, connectLastToFirst=code_block_4)
byPatch = Surface.ByPatch(byPoints)

# group: Define Trunk Constraints
code_block_5 = CodeBlock { {-1,1}; 10; }
byCoordinates = Point.ByCoordinates(x=code_block_5.out1, y=code_block_5.out0)
code_block_6 = CodeBlock { 10; 2; }
byLengths = Cuboid.ByLengths(origin=byCoordinates, width=code_block_6.out0)
byUnion = Solid.ByUnion(byLengths)

subtractFrom = Surface.SubtractFrom(surface=byPatch, trimmingEntity=byUnion)

# group: Tree Spread and Branches
spread = IntegerSlider(29, range=1..30 step 1)
number_branches = IntegerSlider(30, range=1..30 step 1)

# group: Find Paths using MeshToolkit and Lunchbox
code_block_7 = CodeBlock { 0.001; 10000; }
byGeometry = Autodesk.Dynamo.MeshToolkit.Mesh.ByGeometry(subtractFrom, code_block_3, code_block_7.out1)
remesh = Autodesk.Dynamo.MeshToolkit.Mesh.Remesh(byGeometry)
edges = Autodesk.Dynamo.MeshToolkit.Mesh.Edges(remesh)
shuffle = List.Shuffle(edges)
code_block_8 = CodeBlock(x=edges) { x; }
length = Curve.Length(code_block_8)
code_block_9 = CodeBlock(x=spread) { 50-x; 50+x; }
code_block_10 = CodeBlock(x=join, a=code_block_9.out0, b=code_block_9.out1, y=number_branches) { x[0]; x[a..b..#y]; }
byStartPointEndPoint = Line.ByStartPointEndPoint(startPoint=code_block_10.out0, endPoint=code_block_10.out1)
shortestWalk = Geometry.Curves.ShortestWalk(code_block_8, length, byStartPointEndPoint)

# group: Smooth Branches
curves = PolyCurve.Curves(shortestWalk)
firstItem = List.FirstItem(curves@L2)
startPoint = Curve.StartPoint(firstItem)
endPoint = Curve.EndPoint(curves)
addItemToFront = List.AddItemToFront(item=startPoint@L1, list=endPoint@L2)
integer_slider = IntegerSlider(2, range=1..10 step 1)
byControlPoints = NurbsCurve.ByControlPoints(addItemToFront, integer_slider)
