# Dynamo graph Shrink_Grid.dyn (Dynamo 2.0.2.6826)

python_script = Python()  # frozen; unwired: IN[0], IN[1], IN[2]
# ---------- python_script.python (53 lines) ----------
import clr

# ProtoGeometry (Dynamo)
clr.AddReference('ProtoGeometry')
from Autodesk.DesignScript.Geometry import *

# API
clr.AddReference("RevitAPI")
import Autodesk
from Autodesk.Revit.DB import *

# RevtiServices
clr.AddReference("RevitServices")
import RevitServices
from RevitServices.Persistence import DocumentManager
from RevitServices.Transactions import TransactionManager

# RevitNodes, ToDSType method, Geometry conversion
clr.AddReference("RevitNodes")
import Revit
clr.ImportExtensions(Revit.Elements)
clr.ImportExtensions(Revit.GeometryConversion)

# defs
def Convert(num):
	return UnitUtils.ConvertToInternalUnits(num, DisplayUnitType.DUT_MILLIMETERS)

# start
doc = DocumentManager.Instance.CurrentDBDocument

view = UnwrapElement(IN[0])
delta = Convert(IN[1])
grids = [UnwrapElement(item) for item in IN[2]]

test = []
TransactionManager.Instance.EnsureInTransaction(doc)
for g in grids:
	
	# get grid_Curve and change its Y to create a new curve then apply it to the grid
	
	# DatumExtentType.ViewSpecific is important cuz I don't want the changes affect how grid be in other views, but just affect on this particular view.
	curve = g.GetCurvesInView(DatumExtentType.ViewSpecific, view)[0]
	start = curve.GetEndPoint(0)
	end = curve.GetEndPoint(1)
	newStart = XYZ(start.X, start.Y + delta, start.Z)
	newEnd = XYZ(end.X, end.Y - delta, end.Z)
	newCurve = Line.CreateBound(newStart, newEnd)
	g.SetCurveInView(DatumExtentType.ViewSpecific, view, newCurve)

TransactionManager.Instance.TransactionTaskDone()

# end
OUT = 0
# ----------------------------------------
active_view = Python()
# ---------- active_view.python (11 lines) ----------
import clr
clr.AddReference("RevitServices")

import RevitServices
from RevitServices.Persistence import DocumentManager
from RevitServices.Transactions import TransactionManager

doc = DocumentManager.Instance.CurrentDBDocument
view = doc.ActiveView

OUT = view
# ----------------------------------------
BBox = Python(IN[0]=active_view)
# ---------- BBox.python (30 lines) ----------
import clr

# ProtoGeometry (Dynamo)
clr.AddReference('ProtoGeometry')
from Autodesk.DesignScript.Geometry import *

# API
clr.AddReference("RevitAPI")
import Autodesk
from Autodesk.Revit.DB import *

# RevtiServices
clr.AddReference("RevitServices")
import RevitServices
from RevitServices.Persistence import DocumentManager
from RevitServices.Transactions import TransactionManager

# RevitNodes, ToDSType method, Geometry conversion
clr.AddReference("RevitNodes")
import Revit
clr.ImportExtensions(Revit.Elements)
clr.ImportExtensions(Revit.GeometryConversion)
# defs


# start
view = UnwrapElement(IN[0])

# end
OUT = view.CropBox.ToProtoType()
# ----------------------------------------
categories = Categories(index=233)
byCategoryAndView = archilab.Revit.Selection.Select.ByCategoryAndView(category=categories, view=active_view)
grid_plane = Python(IN[0]=byCategoryAndView)
# ---------- grid_plane.python (4 lines) ----------
data = UnwrapElement(IN[0])

OUT = data
#OUT = dir(data[0])
# ----------------------------------------
active_view_2 = Python()
# ---------- active_view_2.python (22 lines) ----------
import clr
#Geometry Extensions to convert Revit Geometry
clr.AddReference("RevitNodes")
import Revit
clr.ImportExtensions(Revit.GeometryConversion)

#Revit Services to Handle Transactions
clr.AddReference("RevitServices")
import RevitServices
from RevitServices.Persistence import DocumentManager
from RevitServices.Transactions import TransactionManager

doc = DocumentManager.Instance.CurrentDBDocument
view = doc.ActiveView

revView = UnwrapElement(view)

cropShape = revView.GetCropRegionShapeManager()
viewBound = cropShape.GetCropShape()

OUT = [dir(i) for i in viewBound]
#OUT = type(viewBound).__name__
# ----------------------------------------
