# Dynamo graph String contains multiple items.dyn (Dynamo 1.2.0.2831)

code_block = CodeBlock { {{"a".."h"},{"c".."g"},{"d".."i"}}; }
code_block_2 = CodeBlock { {"f","e"}; }
contains = String.Contains(str=code_block@L4, searchFor=code_block_2@L1)
