# Dynamo graph Test Python and Revit API.dyn (Dynamo 1.3.0.875)

code_block = CodeBlock { "Revisions on Sheet"; }
categories = Categories("Sheets")
all_elements_of_category = ElementsOfCategory(categories)
code_block_2 = CodeBlock { "33107_Plansprache"; "Ansichten"; }
byParameterValueContains = Revit.ElementFilter.ByParameterValueContains(all_elements_of_category, code_block_2.out0, code_block_2.out1)
revisions = Views.Sheet.Revisions(byParameterValueContains)

# group: Sheet Revisions Runit
python_script = Python()  # unwired: IN[0], IN[1], IN[2]
# ---------- python_script.python (75 lines) ----------
# Copyright(c) 2015, Konrad K Sobon
# @arch_laboratory, http://archi-lab.net

import clr
# Import Element wrapper extension methods
clr.AddReference("RevitNodes")
import Revit
clr.ImportExtensions(Revit.Elements)

# Import DocumentManager and TransactionManager
clr.AddReference("RevitServices")
import RevitServices
from RevitServices.Persistence import DocumentManager
from RevitServices.Transactions import TransactionManager
doc = DocumentManager.Instance.CurrentDBDocument

# Import RevitAPI
clr.AddReference("RevitAPI")
import Autodesk
from Autodesk.Revit.DB import *

import sys
pyt_path = r'C:\Program Files (x86)\IronPython 2.7\Lib'
sys.path.append(pyt_path)

import System
from System import Array
from System.Collections.Generic import *

#The inputs to this node will be stored as a list in the IN variable.
dataEnteringNode = IN

if isinstance(IN[0], list):
	sheets = []
	for i in IN[0]:
		sheets.append(UnwrapElement(i))
else:
	sheets = [UnwrapElement(IN[0])]

if isinstance(IN[1], list):
	revs = []
	for i in IN[1]:
		revs.append(UnwrapElement(i))
else:
	revs = [UnwrapElement(IN[1])]
	
RunIt = IN[2]

if RunIt:
	try:
		errorReport = None
		for i in sheets:
			revisionsOnSheet = i.GetAdditionalRevisionIds()
			for r in revs:
				if r.Id not in revisionsOnSheet:
					revisionsOnSheet.Add(r.Id)
				else:
					continue
			TransactionManager.Instance.EnsureInTransaction(doc)
			i.SetAdditionalRevisionIds(revisionsOnSheet)
			TransactionManager.Instance.TransactionTaskDone()
			
	except:
		# if error accurs anywhere in the process catch it
		import traceback
		errorReport = traceback.format_exc()
else:
	errorReport = "Set RunIt to True."


#Assign your output to the OUT variable
if errorReport == None:
	OUT = IN[0]
else:
	OUT = errorReport
# ----------------------------------------

get_all_revisions = Custom[Get All Revisions]()  # This node will return all Revisions currently defined in the mode.
categories_2 = Categories("Levels")
all_elements_of_category_2 = ElementsOfCategory(categories_2)
code_block_3 = CodeBlock { "Type"; }
getParameterValueByName = Element.GetParameterValueByName(element=all_elements_of_category_2, parameterName=code_block_3)
name = Element.Name(getParameterValueByName)
code_block_4 = CodeBlock { "Hauptebene OKFFB"; }
contains = String.Contains(str=name, searchFor=code_block_4)
filterByBoolMask = List.FilterByBoolMask(list=all_elements_of_category_2, mask=contains)
code_block_5 = CodeBlock { Revit.Application.Document.Current.ActiveView; }
python_script_2 = Python(IN[0]=filterByBoolMask.in, IN[1]=code_block_5)
# ---------- python_script_2.python (39 lines) ----------
import clr
clr.AddReference('ProtoGeometry')
from Autodesk.DesignScript.Geometry import *
#The inputs to this node will be stored as a list in the IN variables.
dataEnteringNode = IN

import clr
clr.AddReference('RevitAPI')
from Autodesk.Revit.DB import *
import Autodesk

clr.AddReference("RevitServices")
import RevitServices
from RevitServices.Persistence import DocumentManager
from RevitServices.Transactions import TransactionManager

doc = DocumentManager.Instance.CurrentDBDocument
uiapp = DocumentManager.Instance.CurrentUIApplication
app = uiapp.Application

a = UnwrapElement(IN[0])
v = UnwrapElement(IN[1])


TransactionManager.Instance.EnsureInTransaction(doc)
for i in a:
	    
    i.SetDatumExtentType(DatumEnds.End0,v, DatumExtentType.ViewSpecific)
    
    i.SetDatumExtentType(DatumEnds.End1,v, DatumExtentType.ViewSpecific)
    
    
TransactionManager.Instance.TransactionTaskDone()

OUT = v


#Assign your output to the OUT variable.
OUT = 0
# ----------------------------------------
