# Dynamo graph ViewAnalysis.dyn (Dynamo 1.2.2.91)

# group: Target Points
number_slider = DoubleSlider(33.975, range=0..100 step 0.1)
number_slider_2 = DoubleSlider(68.516, range=-0.032..100 step 0.1)
number_slider_3 = DoubleSlider(17.394, range=0..100 step 0.1)
byCoordinates = Point.ByCoordinates(x=number_slider, y=number_slider_2, z=number_slider_3)
number_slider_4 = DoubleSlider(-25.764, range=-37.171..100 step 0.1)
number_slider_5 = DoubleSlider(83.487, range=0..100 step 0.1)
number_slider_6 = DoubleSlider(20.052, range=-0.748..100 step 0.1)
byCoordinates_2 = Point.ByCoordinates(x=number_slider_4, y=number_slider_5, z=number_slider_6)

# group: Building Envelope
code_block = CodeBlock { 10; }
byWidthLength = Rectangle.ByWidthLength(width=code_block, length=code_block)
byCoordinates_3 = Point.ByCoordinates()
ZAxis = Vector.ZAxis()
code_block_2 = CodeBlock { 0..45..#2; }
rotate = Geometry.Rotate(geometry=byWidthLength, origin=byCoordinates_3, axis=ZAxis, degrees=code_block_2)
code_block_3 = CodeBlock { 0..50..#2; }
translate = Geometry.Translate(geometry=rotate, zTranslation=code_block_3)
byLoft = Surface.ByLoft(translate)

# group: Panelize Facades
code_block_4 = CodeBlock { 0.2; }
offset = Surface.Offset(byLoft, code_block_4)
explode = Geometry.Explode(offset)
code_block_5 = CodeBlock { 0..1..#6; 0..1..#21; }
pointAtParameter = Surface.PointAtParameter(surface=explode, u=code_block_5.out0, v=code_block_5.out1, lacing=CrossProduct)
quads_from_rectangular_grid = Custom[Quads from Rectangular Grid](Point_List=pointAtParameter@L3)  # Given a grid of points (xyz or uv) in lists of rows/columns, create a list of quadrilaterals
byPerimeterPoints = Surface.ByPerimeterPoints(quads_from_rectangular_grid)

flatten = Flatten(byPerimeterPoints)
code_block_6 = CodeBlock { 0.5; }
pointAtParameter_2 = Surface.PointAtParameter(surface=flatten, u=code_block_6, v=code_block_6)
byLoft_2 = Solid.ByLoft(translate)

# group: Views that collide with the twisty tower
byStartPointEndPoint = Line.ByStartPointEndPoint(startPoint=byCoordinates, endPoint=pointAtParameter_2)
doesIntersect = Geometry.DoesIntersect(geometry=byStartPointEndPoint, other=byLoft_2)
filterByBoolMask = List.FilterByBoolMask(list=byStartPointEndPoint, mask=doesIntersect)
byStartPointEndPoint_2 = Line.ByStartPointEndPoint(startPoint=byCoordinates_2, endPoint=pointAtParameter_2)
doesIntersect_2 = Geometry.DoesIntersect(geometry=byStartPointEndPoint_2, other=byLoft_2)
filterByBoolMask_2 = List.FilterByBoolMask(list=byStartPointEndPoint_2, mask=doesIntersect_2)

# group: View obstructions
number_slider_7 = DoubleSlider(21.668, range=0..100 step 0.1)
number_slider_8 = DoubleSlider(37.231, range=-0.032..100 step 0.1)
byCoordinates_4 = Point.ByCoordinates(x=number_slider_7, y=number_slider_8)
byOrigin = CoordinateSystem.ByOrigin(byCoordinates_4)
code_block_7 = CodeBlock { 10; 5; }
byWidthLength_2 = Rectangle.ByWidthLength(cs=byOrigin, width=code_block_7.out0, length=code_block_7.out1)
code_block_8 = CodeBlock { 30; 15; 35; }
extrudeAsSolid = Curve.ExtrudeAsSolid(curve=byWidthLength_2, distance=code_block_8.out0)
number_slider_9 = DoubleSlider(-19.246, range=-37.171..100 step 0.1)
number_slider_10 = DoubleSlider(34.571, range=0..100 step 0.1)
byCoordinates_5 = Point.ByCoordinates(x=number_slider_9, y=number_slider_10)
byOrigin_2 = CoordinateSystem.ByOrigin(byCoordinates_5)
byWidthLength_3 = Rectangle.ByWidthLength(cs=byOrigin_2, width=code_block_7.out1, length=code_block_7.out0)
extrudeAsSolid_2 = Curve.ExtrudeAsSolid(curve=byWidthLength_3, distance=code_block_8.out1)
number_slider_11 = DoubleSlider(-6.172, range=-6.172..100 step 0.1)
number_slider_12 = DoubleSlider(41.47, range=0..100 step 0.1)
byCoordinates_6 = Point.ByCoordinates(x=number_slider_11, y=number_slider_12)
byOrigin_3 = CoordinateSystem.ByOrigin(byCoordinates_6)
byWidthLength_4 = Rectangle.ByWidthLength(cs=byOrigin_3, width=code_block_7.out0, length=code_block_7.out0)
extrudeAsSolid_3 = Curve.ExtrudeAsSolid(curve=byWidthLength_4, distance=code_block_8.out2)
create = List.Create(extrudeAsSolid, extrudeAsSolid_2, extrudeAsSolid_3)
byUnion = Solid.ByUnion(create)

# group: Detects collision with obstucting buildings
doesIntersect_3 = Geometry.DoesIntersect(geometry=filterByBoolMask.out, other=byUnion)
filterByBoolMask_3 = List.FilterByBoolMask(list=filterByBoolMask.out, mask=doesIntersect_3)
doesIntersect_4 = Geometry.DoesIntersect(geometry=filterByBoolMask_2.out, other=byUnion)
filterByBoolMask_4 = List.FilterByBoolMask(list=filterByBoolMask_2.out, mask=doesIntersect_4)
create_2 = List.Create(filterByBoolMask_3.in, filterByBoolMask_4.in)
flatten_2 = Flatten(create_2)
create_3 = List.Create(filterByBoolMask_3.out, filterByBoolMask_4.out)
flatten_3 = Flatten(create_3)

code_block_9 = CodeBlock { Color.ByARGB(255,255); Color.ByARGB(255,0,255); }
byGeometryColor = Display.Display.ByGeometryColor(flatten_2, code_block_9.out0)
byGeometryColor_2 = Display.Display.ByGeometryColor(flatten_3, code_block_9.out1)
