# Dynamo graph ViewFilter - Archilab_Test.dyn (Dynamo 1.2.0.2831)

views = Views("Test View")
list_all_view_filters_in_current = Custom[List All View Filters in Current Document]()  # uses ParameterFilterElement type selection
element_name_universal = Custom[Element.Name (Universal)](element=list_all_view_filters_in_current)  # Gets an element's name (Dynamo's built-in Name nodes don't work for all element types, e.g. worksets...)
watch = Watch(element_name_universal)
boolean = BoolSelector(true)
activeView = Custom[Springs.Doc.ActiveView](refresh=boolean)  # Selects the current document's active view. Supports more view types than the built-in option. Will be depreciated once the bult in node works with all plan types.
boolean_2 = BoolSelector(true)
add_view_filters_to_view = Custom[Add View Filters to View](viewFilterElements=list_all_view_filters_in_current, targetView=activeView, HideIfFalse=boolean_2)
watch_2 = Watch(add_view_filters_to_view)
views_2 = Views("Level 2 Copy 1")
views_3 = Views("Level 1")
create = List.Create(views_2, views_3)
string = StringInput("Wall Filter")
categories = Categories("Walls")
string_2 = StringInput("Comments")
string_3 = StringInput("Outside wall")
rule_types = FilterRuleUI("Equals")
createRule = Filters.ViewFilter.CreateRule(categories, string_2, string_3, rule_types)
createFilter = Filters.ViewFilter.CreateFilter(string, categories, createRule)
addFilter = Views.View.AddFilter(create, createFilter)
code_block = CodeBlock { 10; }
code_block_2 = CodeBlock { 255; }
byARGB = Color.ByARGB(a=code_block, r=code_block_2, g=code_block, b=code_block)
number_slider = DoubleSlider(4, range=0..17 step 1)
line_pattern = LinePatternElementUI("Loose dash")
fill_patterns = FillPatternUI("Insulation - Rigid")
number_slider_2 = DoubleSlider(2, range=0..100 step 1)
overrideGraphicsSetting = Views.View.OverrideGraphicsSetting(byARGB, number_slider, line_pattern, arg4=fill_patterns, arg8=byARGB, arg9=fill_patterns, arg10=number_slider_2)
setFilterOverrides = Views.View.SetFilterOverrides(addFilter, createFilter, overrideGraphicsSetting)
boolean_3 = BoolSelector(true)
setFilterVisibility = Views.View.SetFilterVisibility(setFilterOverrides, createFilter, boolean_3)
get_view_template_for_view = Custom[Get View Template for View](viewIn=views_3)  # doesn't really work
element_name_universal_2 = Custom[Element Name Universal](Elements=get_view_template_for_view)  # Modified for 0.8.1
watch_3 = Watch(element_name_universal_2)
