# Dynamo graph Wall Exterior Faces.dyn (Dynamo 1.1.0.2094)

seleccionar_elementos = DSModelElementsSelection()  # 10 picked in the model
code_block = CodeBlock { "Wall"; }
removeIfNot = RemoveIfNot(seleccionar_elementos, code_block)
code_block_2 = CodeBlock { "Base Constraint"; }
getParameterValueByName = Element.GetParameterValueByName(element=removeIfNot, parameterName=code_block_2)
groupByKey = List.GroupByKey(list=removeIfNot, keys=getParameterValueByName)
geometry = Element.Geometry(groupByKey.groups)
flatten = Flatten(geometry, lacing=Longest)
byUnion = Solid.ByUnion(flatten)
explode = Geometry.Explode(byUnion)
categories = Categories("Rooms")
all_elements_of_category = ElementsOfCategory(categories)
code_block_3 = CodeBlock { "Level"; }
getParameterValueByName_2 = Element.GetParameterValueByName(element=all_elements_of_category, parameterName=code_block_3)
groupByKey_2 = List.GroupByKey(list=all_elements_of_category, keys=getParameterValueByName_2)
geometry_2 = Element.Geometry(groupByKey_2.groups)
flatten_2 = Flatten(geometry_2, lacing=Longest)
byUnion_2 = Solid.ByUnion(flatten_2)
doesIntersect = Geometry.DoesIntersect(geometry=explode, other=byUnion_2)
code_block_4 = CodeBlock(list=doesIntersect) { List.AllIndicesOf(list<1>, false); }
code_block_5 = CodeBlock(list=explode, index=code_block_4) { List.GetItemAtIndex(list<1>, index<1>); }
