# Dynamo graph aniform03_turntable_simplified.dyn (Dynamo 1.3.0.875)

# group: Establish coordinate system over a sphere with 137.50776 Rotation system
code_block = CodeBlock { 10; }
byCoordinates = Point.ByCoordinates(y=code_block)
byOrigin = CoordinateSystem.ByOrigin(byCoordinates)
code_block_2 = CodeBlock { 5; }
number_of_objects_on_the_surface = IntegerSlider(100, range=0..200 step 1)
rotate_around_the_sphere = CodeBlock(x=number_of_objects_on_the_surface) { 0..#x..137.50776; }
move_up_the_side_of_a_sphere = CodeBlock(x=number_of_objects_on_the_surface) { 1..100..#x; }
bySphericalCoordinates = CoordinateSystem.BySphericalCoordinates(byOrigin, code_block_2, rotate_around_the_sphere, move_up_the_side_of_a_sphere)
bySphericalCoordinates_2 = Point.BySphericalCoordinates(byOrigin, move_up_the_side_of_a_sphere, rotate_around_the_sphere, code_block_2, lacing=Longest)
ZAxis = Vector.ZAxis()
tumble_the_object = CodeBlock(x=number_of_objects_on_the_surface) { 0..#x..2; }
rotate = CoordinateSystem.Rotate(coordinateSystem=bySphericalCoordinates, origin=bySphericalCoordinates_2, axis=ZAxis, degrees=tumble_the_object)
code_block_3 = CodeBlock { 0.5; 1.5; }
remapRange = Math.RemapRange(numbers=move_up_the_side_of_a_sphere, newMin=code_block_3.out0, newMax=code_block_3.out1)

# group: Object to tumble over surface
byLengths = Cuboid.ByLengths(rotate, remapRange, remapRange, remapRange)

byUnion = Solid.ByUnion(byLengths)

# group: Spin Parameters. Time should be a 1000x multiplier of period update. Uses Firefly package
code_block_4 = CodeBlock { 0; 359; 1000000; 0; }
code_block_5 = CodeBlock { 137.50776*1000; }
faderOneWay = Firefly.Utility.FaderOneWay(code_block_4.out0, code_block_5, code_block_4.out2, code_block_4.out3)

# group: Final Rotations. Capture video, then speed up as needed
ZAxis_2 = Vector.ZAxis()
rotate_2 = Geometry.Rotate(geometry=byUnion, origin=byCoordinates, axis=ZAxis_2, degrees=faderOneWay)
watch = Watch(faderOneWay)
code_block_6 = CodeBlock(x=faderOneWay) { x/137.50776; }
