# Dynamo graph bulkUpgrade.dyn (Dynamo 1.2.0.2690)

directory_path = Directory("No file selected.")
contents = Directory.Contents(directory_path)
backgroundOpen = Custom[Document.BackgroundOpen](filePath=contents)  # This will open the input Revit files in the background.
code_block = CodeBlock { true; }
close = Custom[Document.Close](document=backgroundOpen, save=code_block)  # This will close the input Revit document. Offers a boolean toggle to save.
