# Dynamo graph getParametersPy.dyn (Dynamo 1.3.2.2480)

code_block = CodeBlock { Category.ByName("Rooms"); }
all_elements_of_category = ElementsOfCategory(code_block)
code_block_2 = CodeBlock()
# ---------- code_block_2.designscript (7 lines) ----------
{
"Name",
"Area",
"gg_RA_Bauteil",
"gg_RA_Ebene",
"gg_RA_Wohnungsnummer"
};
# ----------------------------------------
dictionary_rooms = Python(IN[0]=all_elements_of_category, IN[1]=code_block_2)
# ---------- dictionary_rooms.python (37 lines) ----------
import sys
import _collections as collections

data = IN[0]
param_name = IN[1]

def cal_num(_lsts):
	new_lst = []
	for lst in _lsts:
		if type(lst) == list:
			new_lst.append([j if i < 2 else '.'.join(lst[2:5]) for i,j in enumerate(lst) if i <= 2])	
	return new_lst		

def null_area(room_lst):
	new_rooms = []
	for room in data:
		if room.GetParameterValueByName(param_name[1]) != "": new_rooms.append(room)
	else: pass
	return new_rooms

filt_rooms = null_area(data)
#values of the room
vals = [[ele.GetParameterValueByName(i) for i in param_name] for ele in filt_rooms]

#short values of the room number
short_vals = cal_num(vals)

#storing the values to sort
val_dict = {}

for name,area,number in short_vals:
	val_dict.setdefault(number, []).append([name,area])
	
#ord_val_dict = collections.OrderedDict(Sorted(val_dict.items()))
chk = val_dict.items()

OUT = chk
# ----------------------------------------
code_block_3 = CodeBlock { "Number"; }
getParameterValueByName = Element.GetParameterValueByName(element=all_elements_of_category, parameterName=code_block_3)
elements_in_room = Custom[Elements in Room]()  # This node will check if any of the elements are inside any of the supplied rooms.; unwired: Elements, Rooms
