# Dynamo graph sharedORproject.dyn (Dynamo 1.3.2.2480)

code_block = CodeBlock { Category.ByName("Rooms"); Category.ByName("Sheets"); }
all_elements_of_category = ElementsOfCategory(code_block.out1)
element_types = ElementTypes("ParameterElement")
all_elements_of_type = ElementsOfType(element_types)
name = Element.Name(all_elements_of_type)
watch = Watch(element_types)
all_elements_of_category_2 = ElementsOfCategory(code_block.out0)
parameters = Element.Parameters(all_elements_of_category_2)
pro_param = Python(IN[0]=parameters)
# ---------- pro_param.python (18 lines) ----------
import clr
clr.AddReference('ProtoGeometry')
from Autodesk.DesignScript.Geometry import *
#The inputs to this node will be stored as a list in the IN variables.
dataEnteringNode = IN
data = IN[0]
check = []
for i in data:
	temp = []
	for j in i:
		a = j.Id
		b = j.Name
		if a > 0 and b[0] != "g" and b[0] != "p": 
			temp.append(j)
	check.append(temp)

#Assign your output to the OUT variable.
OUT = check
# ----------------------------------------
code_block_2 = CodeBlock(a=pro_param) { a[0..2]; }
python_script = Python(IN[0]=code_block_2)
# ---------- python_script.python (19 lines) ----------
import clr
clr.AddReference('ProtoGeometry')
from Autodesk.DesignScript.Geometry import *
#The inputs to this node will be stored as a list in the IN variables.
dataEnteringNode = IN
data = IN[0]

check = []

for i in data:
	temp = []
	for j in i:
		a = dir(j)
		temp.append(a)
	check.append(temp)
		

#Assign your output to the OUT variable.
OUT = check
# ----------------------------------------
