# Dynamo graph wallSplit.dyn (Dynamo 0.9.1.2950)

categories = Categories("Walls")
all_elements_of_category = ElementsOfCategory(categories)
watch = Watch(all_elements_of_category)
parameters = Element.Parameters(all_elements_of_category)
geometry = Element.Geometry(all_elements_of_category)
XY = Plane.XY()
intersect = Geometry.Intersect(geometry=geometry, other=XY)
flatten = Flatten(intersect)
perimeterCurves = Surface.PerimeterCurves(flatten)
length = Curve.Length(perimeterCurves)
minimumItem = List.MinimumItem(length)
eq = _ == minimumItem  # lacing=CrossProduct
map = List.Map(list=length, f_x=eq)
filterByBoolMask = List.FilterByBoolMask(list=perimeterCurves, mask=map)
code_block = CodeBlock { 0.5; }
pointAtParameter = Curve.PointAtParameter(curve=filterByBoolMask.in, param=code_block)
transpose = List.Transpose(pointAtParameter)
code_block_2 = CodeBlock(l=transpose) { l[0]; l[1]; }
byStartPointEndPoint = Line.ByStartPointEndPoint(startPoint=code_block_2.out0, endPoint=code_block_2.out1)
element_types = ElementTypes("Level")
all_elements_of_type = ElementsOfType(element_types)
code_block_3 = CodeBlock { 0..1; 1; }
sublists = List.Sublists(list=all_elements_of_type, ranges=code_block_3.out0, offset=code_block_3.out1)
restOfItems = List.RestOfItems(sublists)
code_block_4 = CodeBlock { -1; }
dropItems = List.DropItems(list=restOfItems, amount=code_block_4)
transpose_2 = List.Transpose(dropItems)
code_block_5 = CodeBlock(w=transpose_2) { w[0]; w[1]; }
name = WallType.Name(all_elements_of_category)
byName = WallType.ByName(name)
byCurveAndLevels = Wall.ByCurveAndLevels(arg1=code_block_5.out0, arg2=code_block_5.out1, arg3=byName)
map_2 = List.Map(list=byStartPointEndPoint, f_x=byCurveAndLevels)
code_block_6 = CodeBlock { "Top Constraint"; }
firstItem = List.FirstItem(sublists)
code_block_7 = CodeBlock(f=firstItem) { f[1]; }
setParameterByName = Element.SetParameterByName(element=all_elements_of_category, parameterName=code_block_6, value=code_block_7)
